% Simulink data dictionary RoboticCourseworkdata.sldd

Sample_time = 0.02
Kd = 0.01
Error_threshold = 0.03
Var = 0
initialguess = [struct(JointName="joint1", JointPosition=0), struct(JointName="joint2", JointPosition=0), struct(JointName="joint3", JointPosition=0), struct(JointName="joint4", JointPosition=0), struct(JointName="joint5", JointPosition=0), struct(JointName="joint6", JointPosition=0)]

ikblock_info_bus = Simulink.Bus()  % Bus associated with Info output of the Inverse Kinematics block.
  Iterations: double  % Number of iterations run by the algorithm.
  PoseErrorNorm: double  % The magnitude of pose error for the solution compared to the desired end-effector pose.
  ExitFlag: uint16  % Code that gives more details on the algorithm execution and what caused it to return.
  Status: uint8  % Integer describing whether the solution is within the tolerance (1) or is the best possible solution the algorithm could find (2).

Ki = 0.02
Kp = 5